# Grasshopper definition 290625_workflow_trash.gh (Grasshopper 1.0.7)
# plug-ins: Vizor, Virtual Robot, Aggregations, GH_MCP, RhinoCodePluginGH

# ----
# MCP Variables
scene_remove = BooleanToggle(False)
scene_update = BooleanToggle(True)
start_task = BooleanToggle(False)
actor_sequence = Panel("""H
R
R""")
cluster_id = Panel("1")

script = Script()  # -> out, a; unedited script template

# ---- group: geometry_agent
component_4 = Python3Script()  # -> out, a, b, c
# ---------- component_4: Python ----------
#! python 3

import Rhino.Geometry as rg
import math
import System.Drawing

# ---------------------------------------------------------------------------
# CLASS DEFINITION
# This is the "blueprint" for our AssemblyElement objects.
# START of :DO NOT TOUCH THIS CODE
# ---------------------------------------------------------------------------
class AssemblyElement:
    def __init__(self, id, type, center_point, direction, length, width=0.05, height=0.05):
        """
        Initializes the element.
        direction: Unit vector for orientation (will be normalized)
        length: Explicit length of the beam
        """
        # Make a copy of the direction vector and ensure it's horizontal
        dir_vector = rg.Vector3d(direction.X, direction.Y, 0)  # Copy and flatten to XY plane
        dir_vector.Unitize()  # Make it a unit vector
        
        # --- Class Properties ---
        self.id = id
        self.type = type
        self.center_point = center_point
        self.direction = dir_vector  # Unit vector for orientation
        self.length = length  # Explicit length
        self.vector = dir_vector * length  # Full vector for geometry creation
        self.width = width
        self.height = height
        self.geometry = self._create_box_geometry()
    
    def _create_box_geometry(self):
        """
        A private helper method to create the 3D Box geometry for the element,
        ensuring it is correctly oriented and dimensioned.
        """
        if self.length == 0: return None

        x_axis = self.vector
        y_axis = rg.Vector3d.CrossProduct(rg.Vector3d.ZAxis, x_axis)
        plane = rg.Plane(self.center_point, x_axis, y_axis)
        x_interval = rg.Interval(-self.length / 2.0, self.length / 2.0)
        y_interval = rg.Interval(-self.width / 2.0, self.width / 2.0)
        z_interval = rg.Interval(-self.height / 2.0, self.height / 2.0)
        return rg.Box(plane, x_interval, y_interval, z_interval)

# END of: DO NOT TOUCH THIS CODE
# ---------------------------------------------------------------------------
# AGENT DEFINITION SECTION => you can edit this part.
# Here, each of the three beams is defined individually and explicitly.
# This section is unchanged.
# This component is variant B 
# ---------------------------------------------------------------------------
# START of : EDIT the code here

assembly_elements = []

# --- BEAM 1 Level 1 ---
center1 = rg.Point3d(2.4428, -0.0996, 0.025)
direction1 = rg.Vector3d(34.48, -19.91, 0)
length1 = 0.40
beam1 = AssemblyElement(id="031", type="green_b", center_point=center1, 
                        direction=direction1, length=length1, width=0.05, height=0.05)
assembly_elements.append(beam1)

# --- BEAM 2 on Level 1 ---
center2 = rg.Point3d(2.0677, -0.0996, 0.025)
direction2 = rg.Vector3d(-34.48, -19.91, 0)
length2 = 0.40
beam2 = AssemblyElement(id="032", type="red_b", center_point=center2, 
                        direction=direction2, length=length2, width=0.05, height=0.05)
assembly_elements.append(beam2)

# --- BEAM 3 Level 2 ---
center3 = rg.Point3d(1.8718, -0.01, 0.075)
direction3 = rg.Vector3d(83.98, 0, 0)
length3 = 0.84
beam3 = AssemblyElement(id="033", type="blue_b", center_point=center3, 
                        direction=direction3, length=length3, width=0.05, height=0.05)
assembly_elements.append(beam3)

# --- BEAM 4 Level 3 ---
center4 = rg.Point3d(1.1551, -0.01, 0.125)
direction4 = rg.Vector3d(83.98, 0, 0)
length4 = 0.84
beam4 = AssemblyElement(id="034", type="orange_b", center_point=center4, 
                        direction=direction4, length=length4, width=0.05, height=0.05)
assembly_elements.append(beam4)

# ===========================================================================
# AGENT EDIT THIS SECTION when asked update/rationalize the geometry run the, `get_all_components_enhanced` and identify the ID of the component named "TRANSFORMATION_VECTOR", then run `get_component_info_enhanced` tool to extract the data. 
# Add the key value pairs to the dictionary bellow.
# Important: Remember to match the element's 'level' to the one in its base deifnition above
# Example: transformations = {
    #"023": rg.Transform.PlaneToPlane(rg.Plane(rg.Point3d(1.5415, -0.1792, 0.075), rg.Vector3d(1.0, 0.0, 0.0), rg.Vector3d(0.0, 1.0, 0.0)), rg.Plane(rg.Point3d(1.5792, -0.1583, 0.075), rg.Vector3d(0.99, 0.02, 0.0), rg.Vector3d(-0.02, 0.99, 0.0))),
#   }
# ===========================================================================
transformations = {
    # This block is waiting for the LLM agent.
}

# END of: EDIT the code here

# ===========================================================================
# APPLY TRANSFORMATIONS
# ===========================================================================
for element in assembly_elements:
    if element.id in transformations:
        transform_to_apply = transformations[element.id]
        element.geometry.Transform(transform_to_apply)
        
# ---------------------------------------------------------------------------
# Define colors based on element type
# ---------------------------------------------------------------------------
display_colors = []
for element in assembly_elements:
    if element.type == "green_b":
        # System.Drawing.Color.FromName takes a string name
        color = System.Drawing.Color.Green 
    elif element.type == "red_b":
        # You can also define colors by their RGB values (0-255)
        color = System.Drawing.Color.Red
    elif element.type == "blue_b":
        # You can also define colors by their RGB values (0-255)
        color = System.Drawing.Color.Blue
    elif element.type == "orange_b":
        color = System.Drawing.Color.Orange
    else:
        # A default color for any other type
        color = System.Drawing.Color.Gray
    display_colors.append(color)

# ---------------------------------------------------------------------------
# OUTPUT
# This part sends the final geometry and colors to the Grasshopper component outputs.
# ---------------------------------------------------------------------------
a = [element.geometry for element in assembly_elements]
b = display_colors 
c = [element.id for element in assembly_elements]
# ---------- end component_4 ----------
component_3 = Python3Script()  # -> out, a, b, c
# ---------- component_3: Python ----------
#! python 3

import Rhino.Geometry as rg
import math
import System.Drawing

# ---------------------------------------------------------------------------
# CLASS DEFINITION
# This is the "blueprint" for our AssemblyElement objects.
# DO NOT TOUCH THIS CODE
# ---------------------------------------------------------------------------
class AssemblyElement:
    def __init__(self, id, type, center_point, direction, length, width=0.05, height=0.05):
        """
        Initializes the element.
        direction: Unit vector for orientation (will be normalized)
        length: Explicit length of the beam
        """
        # Make a copy of the direction vector and ensure it's horizontal
        dir_vector = rg.Vector3d(direction.X, direction.Y, 0)  # Copy and flatten to XY plane
        dir_vector.Unitize()  # Make it a unit vector
        
        # --- Class Properties ---
        self.id = id
        self.type = type
        self.center_point = center_point
        self.direction = dir_vector  # Unit vector for orientation
        self.length = length  # Explicit length
        self.vector = dir_vector * length  # Full vector for geometry creation
        self.width = width
        self.height = height
        self.geometry = self._create_box_geometry()
    
    def _create_box_geometry(self):
        """
        A private helper method to create the 3D Box geometry for the element,
        ensuring it is correctly oriented and dimensioned.
        """
        if self.length == 0: return None

        x_axis = self.vector
        y_axis = rg.Vector3d.CrossProduct(rg.Vector3d.ZAxis, x_axis)
        plane = rg.Plane(self.center_point, x_axis, y_axis)
        x_interval = rg.Interval(-self.length / 2.0, self.length / 2.0)
        y_interval = rg.Interval(-self.width / 2.0, self.width / 2.0)
        z_interval = rg.Interval(-self.height / 2.0, self.height / 2.0)
        return rg.Box(plane, x_interval, y_interval, z_interval)

# END of: DO NOT TOUCH THIS CODE
# ---------------------------------------------------------------------------
# AGENT DEFINITION SECTION => you can edit this part.
# Here, each of the three beams is defined individually and explicitly.
# This section is unchanged.
# This component is variant A - it looks like a triangle
# ---------------------------------------------------------------------------
# START of : EDIT the code here

assembly_elements = []

# --- BEAM 1: Beam on Level 1 ---
center1 = rg.Point3d(1.3124, -0.10, 0.025)
direction1 = rg.Vector3d(-34.48, -19.91, 0)
length1 = 0.40
beam1 = AssemblyElement(id="021", type="green_a", center_point=center1, 
                        direction=direction1, length=length1, width=0.05, height=0.05)
assembly_elements.append(beam1)

# --- BEAM 2: Beam on Level 1 ---
center2 = rg.Point3d(1.6888, -0.10, 0.025)
direction2 = rg.Vector3d(34.48, -19.91, 0)
length2 = 0.40
beam2 = AssemblyElement(id="022", type="red_a", center_point=center2, 
                        direction=direction2, length=length2, width=0.05, height=0.05)
assembly_elements.append(beam2)

# --- BEAM 3: beams on Level 2 ---
center3 = rg.Point3d(1.5115, -0.1792, 0.075)
direction3 = rg.Vector3d(85.0, 0, 0)
length3 = 0.85
beam3 = AssemblyElement(id="023", type="blue_a", center_point=center3, 
                        direction=direction3, length=length3, width=0.05, height=0.05)
assembly_elements.append(beam3)

# --- BEAM 4: beams on Level 3 ---
center4 = rg.Point3d(0.7847, -0.1792, 0.125)
direction4 = rg.Vector3d(80.0, 0, 0)
length4 = 0.80
beam4 = AssemblyElement(id="024", type="orange_a", center_point=center4, 
                        direction=direction4, length=length4, width=0.05, height=0.05)
assembly_elements.append(beam4)

# ===========================================================================
# AGENT EDIT THIS SECTION when asked update/rationalize the geometry run the, `get_all_components_enhanced` and identify the ID of the component named "TRANSFORMATION_VECTOR", then run `get_component_info_enhanced` tool to extract the data. 
# Add the key value pairs to the dictionary bellow.
# Important: Remember to match the element's 'level' to the one in its base deifnition above
# Example: transformations = {
    #"023": rg.Transform.PlaneToPlane(rg.Plane(rg.Point3d(1.5115, -0.1792, 0.075), rg.Vector3d(1.0, 0.0, 0.0), rg.Vector3d(0.0, 1.0, 0.0)), rg.Plane(rg.Point3d(1.5492, -0.1583, 0.075), rg.Vector3d(0.99, 0.02, 0.0), rg.Vector3d(-0.02, 0.99, 0.0))),
#   }
# ===========================================================================
transformations = {
    # This block is waiting for the LLM agent.
}

# END of: EDIT the code here

# ===========================================================================
# APPLY TRANSFORMATIONS
# ===========================================================================
for element in assembly_elements:
    if element.id in transformations:
        transform_to_apply = transformations[element.id]
        element.geometry.Transform(transform_to_apply)
        
# ---------------------------------------------------------------------------
# Define colors based on element type
# ---------------------------------------------------------------------------
display_colors = []
for element in assembly_elements:
    if element.type == "green_a":
        # System.Drawing.Color.FromName takes a string name
        color = System.Drawing.Color.Green 
    elif element.type == "red_a":
        # You can also define colors by their RGB values (0-255)
        color = System.Drawing.Color.Red
    elif element.type == "blue_a":
        color = System.Drawing.Color.Blue
    elif element.type == "orange_a":
        color = System.Drawing.Color.Orange
    else:
        # A default color for any other type
        color = System.Drawing.Color.Gray
    display_colors.append(color)

# ---------------------------------------------------------------------------
# OUTPUT
# This part sends the final geometry and colors to the Grasshopper component outputs.
# ---------------------------------------------------------------------------
a = [element.geometry for element in assembly_elements]
b = display_colors 
c = [element.id for element in assembly_elements]
# ---------- end component_3 ----------

# ----
# Component 1
component_1 = Python3Script()  # -> out, a, b, c
# ---------- component_1: Python ----------
#! python 3


#! python 3

    #! python 3

import Rhino.Geometry as rg
import math
import System.Drawing

# ---------------------------------------------------------------------------
# CLASS DEFINITION
# This is the "blueprint" for our AssemblyElement objects.
# DO NOT TOUCH THIS CODE
# ---------------------------------------------------------------------------
class AssemblyElement:
    # The default values for width and height are now scaled to meters.
    def __init__(self, id, type, center_point, direction, length, width=0.05, height=0.05):
        """
        Initializes the element.
        direction: Unit vector for orientation (will be normalized)
        length: Explicit length of the beam
        """
        # Make a copy of the direction vector and ensure it's horizontal
        dir_vector = rg.Vector3d(direction)  # Just copy the vector
        dir_vector.Unitize()
        
        # --- Class Properties ---
        self.id = id
        self.type = type
        self.center_point = center_point
        self.direction = dir_vector  # Unit vector for orientation
        self.length = length  # Explicit length
        self.vector = dir_vector * length  # Full vector for geometry creation
        self.width = width
        self.height = height
        self.geometry = self._create_box_geometry()
    
    def _create_box_geometry(self):
        """
        A private helper method to create the 3D Box geometry for the element,
        ensuring it is correctly oriented and dimensioned.
        """
        if self.length == 0: return None

        x_axis = self.vector
        y_axis = rg.Vector3d.CrossProduct(rg.Vector3d.ZAxis, x_axis)
        plane = rg.Plane(self.center_point, x_axis, y_axis)
        x_interval = rg.Interval(-self.length / 2.0, self.length / 2.0)
        y_interval = rg.Interval(-self.width / 2.0, self.width / 2.0)
        z_interval = rg.Interval(-self.height / 2.0, self.height / 2.0)
        return rg.Box(plane, x_interval, y_interval, z_interval)

# END of: DO NOT TOUCH THIS CODE
# ---------------------------------------------------------------------------
# AGENT DEFINITION SECTION => you can edit this part.
# Here, each of the three beams is defined individually and explicitly.
# This section is unchanged.
# This component is variant A* - it looks like a triangle
# ---------------------------------------------------------------------------
# START of : EDIT the code here

assembly_elements = []

# --- BEAM 1: Beam on Level 1 ---
center1 = rg.Point3d(-0.1874, -0.10, 0.025)
direction1 = rg.Vector3d(-3.45, -2, 0)
length1 = 0.40
beam1 = AssemblyElement(id="001", type="green_a", center_point=center1,
                        direction=direction1, length=length1, width=0.05, height=0.05)
assembly_elements.append(beam1)


# --- BEAM 2: Beam on Level 1 ---
center2 = rg.Point3d(0.1874, -0.10, 0.025)
direction2 = rg.Vector3d(34.5, -20, 0)
length2 = 0.40
beam2 = AssemblyElement(id="002", type="red_a", center_point=center2,
                        direction=direction2, length=length2, width=0.05, height=0.05)
assembly_elements.append(beam2)


# --- BEAM 3: beams on Level 2 ---
center3 = rg.Point3d(0.04, -0.1792, 0.075)
direction3 = rg.Vector3d(80.0, 0, 0)
length3 = 0.80
beam3 = AssemblyElement(id="003", type="blue_a", center_point=center3,
                        direction=direction3, length=length3, width=0.05, height=0.05)
assembly_elements.append(beam3)

# ===========================================================================
# AGENT EDIT THIS SECTION when asked update/rationalize the geometry run the, `get_all_components_enhanced` and identify the ID of the component named "TRANSFORMATION_VECTOR", then run `get_component_info_enhanced` tool to extract the data. 
# Add the key value pairs to the dictionary bellow.
# Important: Remember to match the element's 'level' to the one in its base deifnition above
# Example: transformations = {
    #\"023\": rg.Transform.PlaneToPlane(rg.Plane(rg.Point3d(1.4635, -0.1792, 0.075), rg.Vector3d(1.0, 0.0, 0.0), rg.Vector3d(0.0, 1.0, 0.0)), rg.Plane(rg.Point3d(1.5012, -0.1583, 0.075), rg.Vector3d(0.99, 0.02, 0.0), rg.Vector3d(-0.02, 0.99, 0.0))),
#   }
# ===========================================================================
transformations = {
    # This block is waiting for the LLM agent.
}


# END of: EDIT the code here

# ===========================================================================
# APPLY TRANSFORMATIONS
# ===========================================================================
for element in assembly_elements:
    if element.id in transformations:
        transform_to_apply = transformations[element.id]
        element.geometry.Transform(transform_to_apply)

# ---------------------------------------------------------------------------
# Define colors based on element type
# ---------------------------------------------------------------------------
display_colors = []
for element in assembly_elements:
    if element.type == "green_a":
        # System.Drawing.Color.FromName takes a string name
        color = System.Drawing.Color.Green 
    elif element.type == "red_a":
        # You can also define colors by their RGB values (0-255)
        color = System.Drawing.Color.Red
    elif element.type == "blue_a":
        # You can also define colors by their RGB values (0-255)
        color = System.Drawing.Color.Blue
    else:
        # A default color for any other type
        color = System.Drawing.Color.Gray
    display_colors.append(color)

# ---------------------------------------------------------------------------
# OUTPUT
# This part sends the final geometry and colors to the Grasshopper component outputs.
# ---------------------------------------------------------------------------
a = [element.geometry for element in assembly_elements]
b = display_colors
c = [element.id for element in assembly_elements]
# ---------- end component_1 ----------
item = ListItem(Index=0, Wrap=True)  # -> Item, Item1, Item2

# ----
# Component 2
component_2 = Python3Script()  # -> out, a, b, c
# ---------- component_2: Python ----------
#! python 3

import Rhino.Geometry as rg
import math
import System.Drawing

# ---------------------------------------------------------------------------
# CLASS DEFINITION
# This is the "blueprint" for our AssemblyElement objects.
# START of :DO NOT TOUCH THIS CODE
# ---------------------------------------------------------------------------
class AssemblyElement:
    def __init__(self, id, type, center_point, direction, length, width=0.05, height=0.05):
        """
        Initializes the element.
        direction: Unit vector for orientation (will be normalized)
        length: Explicit length of the beam
        """
        # Make a copy of the direction vector and ensure it's horizontal
        dir_vector = rg.Vector3d(direction.X, direction.Y, 0)  # Copy and flatten to XY plane
        dir_vector.Unitize()  # Make it a unit vector
        
        # --- Class Properties ---
        self.id = id
        self.type = type
        self.center_point = center_point
        self.direction = dir_vector  # Unit vector for orientation
        self.length = length  # Explicit length
        self.vector = dir_vector * length  # Full vector for geometry creation
        self.width = width
        self.height = height
        self.geometry = self._create_box_geometry()
    
    def _create_box_geometry(self):
        """
        A private helper method to create the 3D Box geometry for the element,
        ensuring it is correctly oriented and dimensioned.
        """
        if self.length == 0: return None

        x_axis = self.vector
        y_axis = rg.Vector3d.CrossProduct(rg.Vector3d.ZAxis, x_axis)
        plane = rg.Plane(self.center_point, x_axis, y_axis)
        x_interval = rg.Interval(-self.length / 2.0, self.length / 2.0)
        y_interval = rg.Interval(-self.width / 2.0, self.width / 2.0)
        z_interval = rg.Interval(-self.height / 2.0, self.height / 2.0)
        return rg.Box(plane, x_interval, y_interval, z_interval)

# END of: DO NOT TOUCH THIS CODE
# ---------------------------------------------------------------------------
# AGENT DEFINITION SECTION => you can edit this part.
# Here, each of the three beams is defined individually and explicitly.
# This section is unchanged.
# This component is variant B* - it looks like a letter Z
# ---------------------------------------------------------------------------
# START of : EDIT the code here

assembly_elements = []

# --- BEAM 1 Level 1 ---
center1 = rg.Point3d(0.9336, -0.10, 0.025)
direction1 = rg.Vector3d(34.48, -19.91, 0)
length1 = 0.40
beam1 = AssemblyElement(id="011", type="green_b", center_point=center1, 
                        direction=direction1, length=length1, width=0.05, height=0.05)
assembly_elements.append(beam1)

# --- BEAM 2 Level 1 ---
center2 = rg.Point3d(0.5588, -0.10, 0.025)
direction2 = rg.Vector3d(-34.48, -19.91, 0)
length2 = 0.40
beam2 = AssemblyElement(id="012", type="red_b", center_point=center2, 
                        direction=direction2, length=length2, width=0.05, height=0.05)
assembly_elements.append(beam2)

# --- BEAM 3 Level 2 ---
center3 = rg.Point3d(0.3995, -0.01, 0.075)
direction3 = rg.Vector3d(83.98, 0, 0)
length3 = 0.84
beam3 = AssemblyElement(id="013", type="blue_b", center_point=center3, 
                        direction=direction3, length=length3, width=0.05, height=0.05)
assembly_elements.append(beam3)

# ===========================================================================
# AGENT EDIT THIS SECTION when asked update/rationalize the geometry run the, `get_all_components_enhanced` and identify the ID of the component named "TRANSFORMATION_VECTOR", then run `get_component_info_enhanced` tool to extract the data. 
# Add the key value pairs to the dictionary bellow.
# Important: Remember to match the element's 'level' to the one in its base deifnition above
# Example: transformations = {
    #"023": rg.Transform.PlaneToPlane(rg.Plane(rg.Point3d(1.4815, -0.1792, 0.075), rg.Vector3d(1.0, 0.0, 0.0), rg.Vector3d(0.0, 1.0, 0.0)), rg.Plane(rg.Point3d(1.5192, -0.1583, 0.075), rg.Vector3d(0.99, 0.02, 0.0), rg.Vector3d(-0.02, 0.99, 0.0))),
#   }
# ===========================================================================
transformations = {
    # This block is waiting for the LLM agent.
}

# END of: EDIT the code here

# ===========================================================================
# APPLY TRANSFORMATIONS
# ===========================================================================
for element in assembly_elements:
    if element.id in transformations:
        transform_to_apply = transformations[element.id]
        element.geometry.Transform(transform_to_apply)
        
# ---------------------------------------------------------------------------
# Define colors based on element type
# ---------------------------------------------------------------------------
display_colors = []
for element in assembly_elements:
    if element.type == "green_b":
        # System.Drawing.Color.FromName takes a string name
        color = System.Drawing.Color.Green 
    elif element.type == "red_b":
        # You can also define colors by their RGB values (0-255)
        color = System.Drawing.Color.Red
    elif element.type == "blue_b":
        # You can also define colors by their RGB values (0-255)
        color = System.Drawing.Color.Blue
    else:
        # A default color for any other type
        color = System.Drawing.Color.Gray
    display_colors.append(color)

# ---------------------------------------------------------------------------
# OUTPUT
# This part sends the final geometry and colors to the Grasshopper component outputs.
# ---------------------------------------------------------------------------
a = [element.geometry for element in assembly_elements]
b = display_colors 
c = [element.id for element in assembly_elements]
# ---------- end component_2 ----------
item_2 = ListItem(Index=0, Wrap=True)  # -> Item, Item1, Item2

preview = CustomPreview(Material={diffuse=RGB(221, 160, 221), emission=RGB(66, 48, 66), shine=0.5, specular=RGB(255, 255, 255), transparency=0})
preview_2 = CustomPreview(Material={diffuse=RGB(221, 160, 221), emission=RGB(66, 48, 66), shine=0.5, specular=RGB(255, 255, 255), transparency=0})

# ----
# Component 4
item_3 = ListItem(Index=0, Wrap=True)  # -> Item, Item1, Item2, Item3
preview_3 = CustomPreview(Material={diffuse=RGB(221, 160, 221), emission=RGB(66, 48, 66), shine=0.5, specular=RGB(255, 255, 255), transparency=0})

# ----
# Component 3
preview_4 = CustomPreview(Material={diffuse=RGB(221, 160, 221), emission=RGB(66, 48, 66), shine=0.5, specular=RGB(255, 255, 255), transparency=0})
item_4 = ListItem(Index=0, Wrap=True)  # -> Item, Item1, Item2, Item3

mcp = GrasshopperMCP(Enabled=Toggle(True), Port=8081, Address="0.0.0.0")  # -> Status, LastCommand

# ---- group: blue B
brep = Brep(item_2.Item2)

# ---- group: blue A
brep_2 = Brep(item.Item2)

# ---- group: red B
brep_3 = Brep(item_2.Item1)

# ---- group: green B
brep_4 = Brep(item_2.Item)

# ---- group: green A
brep_5 = Brep(item.Item)

# ---- group: red A
brep_6 = Brep(item.Item1)

# ---- group: blue B
brep_7 = Brep(item_3.Item2)

# ---- group: green B
brep_8 = Brep(item_3.Item)

# ---- group: red B
brep_9 = Brep(item_3.Item1)

# ---- group: orange B
brep_10 = Brep(item_3.Item3)

# ---- group: blue A
brep_11 = Brep(item_4.Item2)

# ---- group: orange A
brep_12 = Brep(item_4.Item3)

# ---- group: green A
brep_13 = Brep(item_4.Item)

# ---- group: red A
brep_14 = Brep(item_4.Item1)

# ----
# unit 3
panel = Panel("Unit1")

# ----
# unit 1
panel_2 = Panel("Unit1*")

# ----
# unit 2
panel_3 = Panel("Unit2*")

# ---- group: Gree
# unit 4
panel_4 = Panel("Unit2")

# ----
panel_5 = Panel("ws://localhost:9090/")

# ----
# Docker Connection
button = Button()
wsstart = WsConnection(Address="ws://127.0.0.1:9090", Reset=button)

# ----
# Define Robot
pt = Point(<point referenced from the Rhino model>)
xy = XYPlane(Origin=pt)
brep_15 = Brep([<brep referenced from the Rhino model> x3])
scale = Scale(Geometry=brep_15, Center=Point(0, 0, 0), Factor=1000)  # -> Geometry, Transform
scale_2 = Scale(Geometry=xy, Center=Point(0, 0, 0), Factor=1000)  # -> Geometry, Transform
end_effector = DefineEndEffector(Geometry=scale.Geometry, TCPFrame=scale_2.Geometry, MountingFrame=PlaneXY(0, 0, 0))
xy_2 = XYPlane(Origin=Point(0, 0, 0))
ur10 = PredefinedUniversalRobotUR10(BaseFrame=xy_2, EndEffectorOptional=end_effector)
panel_6 = Panel("""base_link
base_link_inertia
shoulder_link
upper_arm_link
forearm_link
wrist_1_link
wrist_2_link
wrist_3_link
flange
tool0
gripper_base
gripper_fingers
tcp""")
robot = Robot(
    WebsocketObject=wsstart,
    Disable=False,
    RobotName="UR10",
    VirtualRobotModelNS=ur10,
    LinkNames=["base_link", "link_1", "link_2", "link_3", "link_4", "link_5"])  # -> Output, RobotObject

# ----
# unit 1*
panel_7 = Panel("Unit1")

# ----
# unit 2 *
panel_8 = Panel("Unit2")  # disabled

# ---- group: blue A
brep_16 = Brep(brep_2)

# ---- group: red A
brep_17 = Brep(brep_6)

# ---- group: green A
brep_18 = Brep(brep_5)

# ---- group: blue B
brep_19 = Brep(<brep referenced from the Rhino model>)  # disabled

# ---- group: green B
brep_20 = Brep(<brep referenced from the Rhino model>)  # disabled

# ---- group: red B
brep_21 = Brep(<brep referenced from the Rhino model>)  # disabled

# ----
# Define AR Clients
panel_9 = Panel("HOLO1")
hololens = Hololens(
    WebsocketObject=wsstart,
    Disable=Button(),
    DeviceName=panel_9,
    SkillConfiguration="{'robot-control': 1, 'screw': 1, 'pick-and-place': 1}")  # -> Output, ARDevice

# ----
# Define Marker
panel_10 = Panel("marker1")
inputdevice = ARInputDevice(WebsocketObject=wsstart, Disable=Button(), DeviceName=panel_10)  # -> Output, ARDevice

num = Number(cluster_id)
filter = StreamFilter(Gate=num, Stream1=brep_18)
filter_2 = StreamFilter(Gate=num, Stream1=brep_16)
filter_3 = StreamFilter(Gate=num, Stream1=brep_17)
filter_4 = StreamFilter(Gate=num, Stream1=panel_7)
txt = Text(filter_4)

# ---- group: blue A
brep_22 = Brep(filter_2)

# ---- group: red A
brep_23 = Brep(filter_3)

# ---- group: green A
brep_24 = Brep(filter)

# ----
item_5 = ListItem(List=txt, Index=0, Wrap=True)  # -> Item, Item1, Item2

# ----
# Model Tracker Debugging
panel_11 = Panel("""dynamic_001
dynamic_002
dynamic_003""")
geo = Geometry()
modeltracker = ModelTracker(Online=Toggle(True), ARDevice=hololens.ARDevice, Meshes=geo, Names=panel_11)  # -> Status, Names, DebugTransformsX, DebugTransformsT, TransformedMesh
transform = Transform(Geometry=geo, Transform=modeltracker.DebugTransformsX)
transform_2 = Transform(Geometry=transform, Transform=modeltracker.DebugTransformsT)
geo_2 = Geometry(transform_2)

# ----
# Path Plan Debugging
pt_2 = Point(<point referenced from the Rhino model>)
xz = XZPlane(Origin=pt_2)
yz = YZPlane(Origin=pt_2)
xy_3 = XYPlane(Origin=pt_2)
flip_plane = FlipPlane(Plane=xz)
flip_plane_2 = FlipPlane(Plane=xy_3)
plan = GenerateMotion(
    Robot=robot.RobotObject,
    TargetPose=flip_plane_2,
    PathName="pickup",
    Plan=Toggle(True),
    Execute=False,
    Request=Toggle(False))  # -> Output, TrajectoryObject, TrajectoryMesh, TrajectoryValues

data = Data(hololens.ARDevice)

# ----
# Gaze Target
online = BooleanToggle(True)
gazetracker = GazeTracker(Online=online, ARDevice=data)
panel_12 = Panel(gazetracker)

# ---- group: 3 x 1 = 3 tasks
cluster = Cluster(M=brep_24, txt=item_5.Item, col=ColourSwatch(SwatchColor=RGB(78, 169, 77)), data=inputdevice.ARDevice)  # -> M_2, content_2
cluster_2 = Cluster(M=brep_23, txt=item_5.Item1, col=ColourSwatch(SwatchColor=RGB(181, 62, 53)), data=inputdevice.ARDevice)  # -> M_2, content_2
cluster_3 = Cluster(M=brep_22, txt=item_5.Item2, col=ColourSwatch(SwatchColor=RGB(23, 0, 212)), data=inputdevice.ARDevice)  # -> M_2, content_2
human_task_name = Panel("""Beam 1 green
Beam 2 red
Beam 3 blue""")
merge = Merge(Data1=cluster.content_2, Data2=cluster_2.content_2, Data3=cluster_3.content_2)
task = ConstructTaskObject(TaskNames=human_task_name, TargetDevices=data, SceneContents=merge, AssociatedSkill="null", EstimatedDuration=60)  # -> Output, TaskObject

# ----
py3 = Python3Script(seq=actor_sequence)  # -> out, pattern; inputs seq: list of String
# ---------- py3: Python ----------
"""Grasshopper Script"""
# a = "Hello Python 3 in Grasshopper!"
# print(a)

pattern = []

print(len(seq))

for i in range (3):
    if seq[i] == "H":
        pattern.append(0)
    elif seq[i] == "R":
        pattern += [1,1,1]
    else:
        print (seq[i])
        raise TypeError("Actor is neither human or robot.")
# ---------- end py3 ----------

# ----
# Scene Update
scene_model = XRSceneModel(
    GHControl=True,
    ARDevices=data,
    ContentObjects=merge,
    TriggerSend=scene_update,
    TriggerRemove=scene_remove,
    TimeDelay=100)
panel_13 = Panel(scene_model)

brep_25 = Brep([<brep referenced from the Rhino model> x14])
item_6 = ListItem(List=brep_25, Index=Slider(6, range=0..14), Wrap=True)
item_7 = ListItem(List=txt, Index=0, Wrap=True)

data_2 = Data(robot.RobotObject)
brep_26 = Brep(item_6)
txt_2 = Text(item_7)

pt_3 = Point(Point(-0.5739246967, 0.03830774993, 0.5250377575))
pt_4 = Point(Point(0.09840871164, -0.4383395091, 0.5250377575))
pt_5 = Point(<point referenced from the Rhino model>)
xy_4 = XYPlane(Origin=pt_3)
xy_5 = XYPlane(Origin=pt_4)
rotate = Rotate(Geometry=xy_5, Angle=Slider(3.14, range=0..10), Plane=xy_5)  # -> Geometry, Transform
rotate_2 = Rotate(Geometry=xy_4, Angle=Slider(1.71, range=-1.71..1.71), Plane=xy_4)  # -> Geometry, Transform
flip_plane_3 = FlipPlane(Plane=rotate_2.Geometry)
flip_plane_4 = FlipPlane(Plane=rotate.Geometry)

# ---- group: pick up position
xy_6 = XYPlane(Origin=pt_5)

# ----
pflip = FlipPlane(Plane=rotate_2.Geometry, ReverseX=False, ReverseY=False, SwapAxes=True)
pflip_2 = FlipPlane(Plane=rotate.Geometry, ReverseX=False, ReverseY=False, SwapAxes=True)
pflip_3 = FlipPlane(Plane=xy_6, ReverseX=False, ReverseY=False, SwapAxes=True)

flip_plane_5 = FlipPlane(Plane=xy_6)
pln = Plane([pflip, pflip_2])

# ----
# Planning Scene
brep_27 = Brep(<brep referenced from the Rhino model>)
orient = Orient(Geometry=brep_27, Source=pflip_3, Target=PlaneXY(0, 0, 0))  # -> Geometry, Transform
scale_nu = ScaleNU(Geometry=orient.Geometry, Plane=PlaneXY(0, 0, 0), ScaleX=".9", ScaleY=1, ScaleZ=".9")  # -> Geometry, Transform
mesh = SceneMeshObject(
    TargetAnchor=robot.RobotObject,
    Meshes=scale_nu.Geometry,
    Names="ee-beam",
    Colours=RGB(9, 169, 237),
    DisplayRules="flange")  # -> Output, MeshGeometryObjects
send = Button()
remove = Button()
planningscene = PlanningSceneModel(Robot=robot.RobotObject, SceneGeometries=mesh.MeshGeometryObjects, TriggerSend=send, TriggerRemove=remove)

# ---- group: 3 x 3 = 9 tasks
cluster_4 = Cluster_3(brep=brep_24, txt=item_5.Item, data=robot.RobotObject, home=pln, pickplane=flip_plane_5, robot=ur10)
cluster_5 = Cluster_3(brep=brep_23, txt=item_5.Item1, data=robot.RobotObject, home=pln, pickplane=flip_plane_5, robot=ur10)
cluster_6 = Cluster_3(brep=brep_22, txt=item_5.Item2, data=robot.RobotObject, home=pln, pickplane=flip_plane_5, robot=ur10)
merge_2 = Merge(Data1=flatten(cluster_4), Data2=flatten(cluster_5), Data3=flatten(cluster_6))

# ----
weave = Weave(Pattern=[0, 1], Stream0=task.TaskObject, Stream1=merge_2, NullGaps=False)

# ----
# Task Execution
taskctrl = TaskController(Start=start_task, HRCTasks=weave, GHControl=True)  # -> CurrentTask, ProcessLog
exec_mode = BooleanToggle(False)
start = BooleanToggle(False)
panel_14 = Panel(taskctrl.ProcessLog)
simulate = SimulateDevice(
    NetworkDevice=hololens.ARDevice,
    TriggerAcknowledge=Button(),
    TriggerReject=False,
    TriggerPing=False,
    TriggerHelp=False,
    TaskID=0)
executor = RobotExecution(Robot=robot.RobotObject, RobotTask=taskctrl.CurrentTask, Start=start, Physical=exec_mode)
panel_15 = Panel(simulate)

pln_2 = Plane(pflip_3)
robot_trajectory = RobotTrajectory(pln_2=pln, pln=pln_2, brep=brep_26)  # -> R, R_2, R_3, pl_2
cartesian = BooleanToggle(True)
cluster_7 = Cluster_2(relay_3=data_2, relay=brep_26, relay_2=robot_trajectory.pl_2, B=pln_2)  # -> M, M_2, M_3
trajectory = RobotTrajectoryObject(TargetRobot=data_2, IsCartesian=cartesian, TCPFrames=robot_trajectory.R, TrajectoryWidth=0.01)  # -> Output, TrajectoryObject, TrajectoryMesh
trajectory_2 = RobotTrajectoryObject(TargetRobot=data_2, IsCartesian=cartesian, TCPFrames=robot_trajectory.R_2, TrajectoryWidth=0.01)  # -> Output, TrajectoryObject, TrajectoryMesh
trajectory_3 = RobotTrajectoryObject(TargetRobot=data_2, IsCartesian=cartesian, TCPFrames=robot_trajectory.R_3, TrajectoryWidth=0.01)  # -> Output, TrajectoryObject, TrajectoryMesh
content = ConstructSceneContent(Name="content object", Meshes=cluster_7.M, LevelOfDetail=0)
content_2 = ConstructSceneContent(Name="content object", Meshes=cluster_7.M_2, LevelOfDetail=0)
content_3 = ConstructSceneContent(Name="content object", Meshes=cluster_7.M_3, LevelOfDetail=0)
panel_16 = Panel("""_pickup
_place
_home""")
merge_3 = Merge(
    Data1=flatten(trajectory.TrajectoryObject),
    Data2=flatten(trajectory_2.TrajectoryObject),
    Data3=flatten(trajectory_3.TrajectoryObject))
merge_4 = Merge(Data1=flatten(content), Data2=flatten(content_2), Data3=flatten(content_3))
concat = Concatenate(FragmentA=txt_2, FragmentB=panel_16)
task_2 = ConstructTaskObject(
    TaskNames=concat,
    TargetDevices=data_2,
    SceneContents=merge_4,
    RobotTrajectory=merge_3,
    AssociatedSkill="null",
    EstimatedDuration=60)  # -> Output, TaskObject
item_8 = ListItem(List=task_2.TaskObject, Index=Slider(1, range=0..10), Wrap=True)
simulator = RobotSimulator(Robot=robot.RobotObject, RobotTask=item_8, StepInterval=Slider(500, range=0..1000), Start=Toggle(False))  # -> Output, CurrentTCP, CurrentGeometry, ExternalAxis
panel_17 = Panel(simulator.CurrentTCP)

# ----
# Virtual Robot Debugging
number_slider = Slider(0.21, range=0.01..0.99)
merge_5 = Merge(Data1=robot_trajectory.R, Data2=robot_trajectory.R_2, Data3=robot_trajectory.R_3)
scale_3 = Scale(Geometry=merge_5, Center=Point(0, 0, 0), Factor=1000)  # -> Geometry, Transform
iframe = InterpolateFrames(Frames=scale_3.Geometry, Length=number_slider, Step="1", Reset=Toggle(True))  # -> Frame, Percent, CurrentIndex
robot_ik = RobotInverseKinematics(Robot=ur10, TargetTCPFrame=iframe.Frame, AxisToggles=[False, False, False], useColorPreview=True)  # -> PoseGeometry, AxisValues, AxisFrames
scale_4 = Scale(Geometry=iframe.Frame, Center=Point(0, 0, 0), Factor=0.001)  # -> Geometry, Transform
orient_2 = Orient(Geometry=brep_26, Source=robot_trajectory.pl_2, Target=scale_4.Geometry)  # -> Geometry, Transform
scale_5 = Scale(Geometry=robot_ik.PoseGeometry, Center=Point(0, 0, 0), Factor=0.001)  # -> Geometry, Transform

# ==== cluster Cluster
txt = ClusterInput()
col = ClusterInput()
data = ClusterInput()
M = ClusterInput()
col_2 = Colour(col)
data_2 = Data(data)
txt_2 = Text(txt)
yz = YZPlane(Origin=Point(0, 0, 0))
concat = Concatenate(FragmentA="dynamic_", FragmentB=txt_2)
mesh = SceneMeshObject(TargetAnchor=data_2, Meshes=M, Names=concat, Colours=col_2, DisplayRules="session")  # -> Output, MeshGeometryObjects
# Create Content Object
text = SceneTextObject(TargetAnchor=data_2, Texts=txt_2, Planes=yz, Names=txt_2, Colours=col_2, Solid=False, DisplayRules="session")  # -> Output, TextObjects
split = TextSplit(Text=txt_2, Separators="_")
item = ListItem(List=split, Index=0, Wrap=True)  # -> Item, Item1
content = ConstructSceneContent(Name=item.Item1, Meshes=mesh.MeshGeometryObjects, Texts=text.TextObjects, LevelOfDetail=0)  # -> flatten(ContentObject)
content_2 = ClusterOutput(content)
M_2 = ClusterOutput(mesh.MeshGeometryObjects)

# ==== cluster RobotTrajectory
pln = ClusterInput()
brep = ClusterInput()
pln_2 = ClusterInput()

# ---- group: pickup point
pln_3 = Plane(pln)

# ---- group: beam
brep_2 = Brep(brep)

# ---- group: home
pln_4 = Plane(pln_2)

# ---- group: placement point
debrep = DeconstructBrep(Brep=brep_2)  # -> Faces, Edges, Vertices
area = Area(Geometry=debrep.Faces)  # -> Area, Centroid
pdecon = Deconstruct(Point=area.Centroid)  # -> XComponent, YComponent, ZComponent
sort = SortList(Keys=pdecon.ZComponent, ValuesA=debrep.Faces)  # -> Keys, ValuesA
item = ListItem(List=reverse(sort.ValuesA), Index=0, Wrap=True)
debrep_2 = DeconstructBrep(Brep=item)  # -> Faces, Edges, Vertices
area_2 = Area(Geometry=item)  # -> Area, Centroid
len = Length(Curve=debrep_2.Edges)
sort_2 = SortList(Keys=len, ValuesA=debrep_2.Edges)  # -> Keys, ValuesA
item_2 = ListItem(List=sort_2.ValuesA, Index=0, Wrap=True)  # -> Item, Item1, Item2
py3 = Python3Script(line=item_2.Item)  # -> out, oLine; inputs line: Line
# ---------- py3: Python ----------
"""Grasshopper Script"""

import Rhino.Geometry as rg


start = line.PointAt(0)
end = line.PointAt(1)

if start.Y > end.Y:
    a = start
    b = end
else:
    a = end
    b = start

oLine = rg.Line(a, b)
# ---------- end py3 ----------
py3_2 = Python3Script(line=item_2.Item2)  # -> out, oLine; inputs line: Line
# ---------- py3_2: Python ----------
"""Grasshopper Script"""

import Rhino.Geometry as rg


start = line.PointAt(0)
end = line.PointAt(1)

if start.X > end.X:
    a = start
    b = end
else:
    a = end
    b = start

oLine = rg.Line(a, b)
# ---------- end py3_2 ----------
pl = ConstructPlane(Origin=area_2.Centroid, XAxis=<missing>, YAxis=<missing>)

# ----
pl_2 = ClusterOutput(pl)
Z = UnitZ(Factor="0.3")
item_3 = ListItem(List=pln_4, Index=0, Wrap=True)
move = Move(Geometry=pln_3, Motion=Z)  # -> Geometry, Transform
move_2 = Move(Geometry=pl, Motion=Z)  # -> Geometry, Transform
rev = ReverseList(List=pln_4)
merge = Merge(Data1=flatten(item_3), Data2=flatten(move.Geometry), Data3=flatten(pln_3))
merge_2 = Merge(
    Data1=flatten(pln_3),
    Data2=flatten(move.Geometry),
    Data3=flatten(pln_4),
    Data4=flatten(move_2.Geometry),
    Data5=flatten(pl))
merge_3 = Merge(Data1=flatten(pl), Data2=flatten(move_2.Geometry), Data3=flatten(rev))
R = ClusterOutput(merge)
R_2 = ClusterOutput(merge_2)
R_3 = ClusterOutput(merge_3)

# ==== cluster Cluster_2
B = ClusterInput()
relay = ClusterInput()
relay_2 = ClusterInput()
relay_3 = ClusterInput()
list = ValueList({"session", "step", "persistent", "flange"}, selected="flange")
list_2 = ValueList({"session", "step", "persistent", "flange"}, selected="step")
orient = Orient(Geometry=relay, Source=relay_2, Target=B)  # -> Geometry, Transform
orient_2 = Orient(Geometry=relay, Source=relay_2, Target=PlaneXY(0, 0, 0))  # -> Geometry, Transform
list_3 = ValueList({"session", "step", "persistent", "flange"}, selected="session")
mesh = SceneMeshObject(
    TargetAnchor=relay_3,
    Meshes=orient.Geometry,
    Names="pick-beam",
    Colours=ColourSwatch(SwatchColor=RGB(170, 240, 207)),
    DisplayRules=list_2)  # -> Output, MeshGeometryObjects
mesh_2 = SceneMeshObject(
    TargetAnchor=relay_3,
    Meshes=orient_2.Geometry,
    Names="ee-beam",
    Colours=ColourSwatch(SwatchColor=RGB(255, 117, 117)),
    DisplayRules=list)  # -> Output, MeshGeometryObjects
mesh_3 = SceneMeshObject(
    TargetAnchor=relay_3,
    Meshes=relay,
    Names="final-beam",
    Colours=ColourSwatch(SwatchColor=RGB(94, 219, 219)),
    DisplayRules=list_3)  # -> Output, MeshGeometryObjects
M = ClusterOutput(mesh.MeshGeometryObjects)
M_2 = ClusterOutput(mesh_2.MeshGeometryObjects)
M_3 = ClusterOutput(mesh_3.MeshGeometryObjects)

# ==== cluster Cluster_3
home = ClusterInput()
pickplane = ClusterInput()
brep = ClusterInput()
txt = ClusterInput()
data = ClusterInput()

brep_2 = Brep(brep)
txt_2 = Text(txt)
data_2 = Data(data)

robot_trajectory = RobotTrajectory(pln_2=home, pln=pickplane, brep=brep_2)  # -> R, R_2, R_3, pl_2
cartesian = BooleanToggle(True)
cluster = Cluster_2(relay_3=data_2, relay=brep_2, relay_2=robot_trajectory.pl_2, B=pickplane)  # -> M, M_2, M_3
trajectory = RobotTrajectoryObject(TargetRobot=data_2, IsCartesian=cartesian, TCPFrames=robot_trajectory.R, TrajectoryWidth=0.01)  # -> Output, TrajectoryObject, TrajectoryMesh
trajectory_2 = RobotTrajectoryObject(TargetRobot=data_2, IsCartesian=cartesian, TCPFrames=robot_trajectory.R_2, TrajectoryWidth=0.01)  # -> Output, TrajectoryObject, TrajectoryMesh
trajectory_3 = RobotTrajectoryObject(TargetRobot=data_2, IsCartesian=cartesian, TCPFrames=robot_trajectory.R_3, TrajectoryWidth=0.01)  # -> Output, TrajectoryObject, TrajectoryMesh
content = ConstructSceneContent(Name="content object", Meshes=cluster.M, LevelOfDetail=0)
content_2 = ConstructSceneContent(Name="content object", Meshes=cluster.M_2, LevelOfDetail=0)
content_3 = ConstructSceneContent(Name="content object", Meshes=cluster.M_3, LevelOfDetail=0)
robot = ClusterInput()

# ----
# Virtual Robot Debugging
number_slider = Slider(0.21, range=0.01..0.99)  # disabled
merge = Merge(Data1=robot_trajectory.R, Data2=robot_trajectory.R_2, Data3=robot_trajectory.R_3)  # disabled
toggle = BooleanToggle(True)  # disabled
scale = Scale(Geometry=merge, Center=Point(0, 0, 0), Factor=1000)  # -> Geometry, Transform; disabled
panel = Panel("1")  # disabled
iframe = InterpolateFrames(Frames=scale.Geometry, Length=number_slider, Step=panel, Reset=toggle)  # -> Frame, Percent, CurrentIndex; disabled
robot_ik = RobotInverseKinematics(Robot=robot, TargetTCPFrame=iframe.Frame, AxisToggles=[False, False, False], useColorPreview=True)  # -> PoseGeometry, AxisValues, AxisFrames; disabled
scale_2 = Scale(Geometry=iframe.Frame, Center=Point(0, 0, 0), Factor=0.001)  # -> Geometry, Transform; disabled
scale_3 = Scale(Geometry=robot_ik.PoseGeometry, Center=Point(0, 0, 0), Factor=0.001)  # -> Geometry, Transform; disabled
orient = Orient(Geometry=brep_2, Source=robot_trajectory.pl_2, Target=scale_2.Geometry)  # -> Geometry, Transform; disabled

panel_2 = Panel("""_pickup
_place
_home""")
merge_2 = Merge(
    Data1=flatten(trajectory.TrajectoryObject),
    Data2=flatten(trajectory_2.TrajectoryObject),
    Data3=flatten(trajectory_3.TrajectoryObject))
merge_3 = Merge(Data1=flatten(content), Data2=flatten(content_2), Data3=flatten(content_3))
concat = Concatenate(FragmentA=txt_2, FragmentB=panel_2)
task = ConstructTaskObject(
    TaskNames=concat,
    TargetDevices=data_2,
    SceneContents=merge_3,
    RobotTrajectory=merge_2,
    AssociatedSkill="null",
    EstimatedDuration=60)  # -> Output, TaskObject
task_2 = ClusterOutput(task.TaskObject)
